# Grasshopper definition 00_Base Model.gh (Grasshopper 1.0.7)
# plug-ins: CORE.Grasshopper.Colibri, CORE.Toolbox.Grasshopper

path = FilePath("C:\Users\prana\OneDrive - Delft University of Technology\Thesis\02_Working\epw\NLD_Amsterdam.062400_IWEC\NLD_Amsterdam.062400_IWEC.epw")
# M - B  - 03
# 
# Task - EPW file setup
# 
# Description - EPW files readily available online
# are downloaded and saved to the project folder.
#  This information can be further used to simulate
#  with the climate of the Netherlands.
path_2 = FilePath("C:\Users\prana\OneDrive - Delft University of Technology\Thesis\02_Working\epw\NLD_Amsterdam.062400_IWEC\NLD_Amsterdam.062400_IWEC.ddy")
climate = Panel(path)
climate_2 = Panel(path_2)
item = ListItem(List=climate, Index=0, Wrap=True)
item_2 = ListItem(List=climate_2, Index=0, Wrap=True)
importepw = LBImportEPW(epw_file=item)  # -> location, dry_bulb_temperature, dew_point_temperature, relative_humidity, wind_speed, wind_direction, direct_normal_rad, diffuse_horizontal_rad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; plug-in component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
sizingpar = HBSizingParameter(ddy_file=item_2)  # -> sizing; plug-in component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

glassmod = HBGlassModifier(name="Window", trans="0.87")  # -> modifier; plug-in component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
opaquemod = HBOpaqueModifier(name="Base", reflect="0.7")  # -> modifier; plug-in component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
opaquemod_2 = HBOpaqueModifier(name="Ceiling", reflect="0.7")  # -> modifier; plug-in component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
opaquemod_3 = HBOpaqueModifier(name="Walls", reflect="0.2")  # -> modifier; plug-in component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
subfacesubset = HBSubfaceModifierSubset(window=glassmod)  # -> subface_set; plug-in component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
exteriorsubset = HBExteriorModifierSubset(exterior_wall=opaquemod_3, exterior_roof=opaquemod_2, exposed_floor=opaquemod)  # -> exterior_set; plug-in component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
modifierset = HBModifierSet(exterior_subset=exteriorsubset, subface_subset=subfacesubset)  # -> mod_set; plug-in component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

path_3 = FilePath(["C:\Users\prana\OneDrive - Delft University of Technology\Thesis\02_Working\BSDF\10_VB_50_L\VB_50_0_L.xml", "C:\Users\prana\OneDrive - Delft University of Technology\Thesis\02_Working\BSDF\10_VB_50_L\VB_50_15_L.xml", "C:\Users\prana\OneDrive - Delft University of Technology\Thesis\02_Working\BSDF\10_VB_50_L\VB_50_30_L.xml", "C:\Users\prana\OneDrive - Delft University of Technology\Thesis\02_Working\BSDF\10_VB_50_L\VB_50_45_L.xml", "C:\Users\prana\OneDrive - Delft University of Technology\Thesis\02_Working\BSDF\10_VB_50_L\VB_50_60_L.xml", "C:\Users\prana\OneDrive - Delft University of Technology\Thesis\02_Working\BSDF\10_VB_50_L\VB_50_75_L.xml", "C:\Users\prana\OneDrive - Delft University of Technology\Thesis\02_Working\BSDF\10_VB_50_L\VB_50_90_L.xml"])
path_4 = FilePath("C:\Users\prana\OneDrive - Delft University of Technology\Thesis\02_Working\BSDF\10_VB_50_L\VB_50_75_L.xml")
path_5 = FilePath("C:\Users\prana\OneDrive - Delft University of Technology\Thesis\02_Working\BSDF\10_VB_50_L\VB_50_90_L.xml")

genes = GenePool(Decimals=1, Maximum=1, Minimum=0, Value=[0, 0, 0, 0, 0, 0, 0, 0, 0, 0, 0, 0, 0, 0, 0, 0, 0, 0, 0, 0, 0, 0, 0, 0])
genes_2 = GenePool(Decimals=1, Maximum=1, Minimum=0, Value=[0, 0, 0, 0, 0, 0, 0.5, 0.5, 1, 1, 1, 1, 1, 1, 1, 1, 1, 1, 1, 0.5, 0.5, 0, 0, 0])
weeklyschedule = HBWeeklySchedule(
    sun=genes,
    mon=genes_2,
    tue=genes_2,
    wed=genes_2,
    thu=genes_2,
    fri=genes_2,
    sat=genes,
    holiday=genes,
    name="Occ",
    type_limit="Fractional")  # -> report, schedule, idf_year, idf_week, idf_days; plug-in component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

number_slider = Slider(1.7, range=0..3)
number_slider_2 = Slider(0.8, range=0..1.2)
# M - B - 01
# 
# Task - Setup of Base Model
# 
# Description - The base model sets up a room
# with windows on one side that can be adjusted
# as per preference.
number_slider_3 = Slider(0.02, range=0..1.2)
cluster = Cluster(
    X=Slider(5, range=0..5),
    Y=Slider(6, range=0..6),
    F=Slider(3, range=0..5),
    N=Slider(5, range=0..10),
    A=Slider(0.9, range=0..2),
    F_2=number_slider,
    F_3=number_slider_2,
    A_2=number_slider,
    B=number_slider_2,
    F_4=number_slider_3,
    F_5=number_slider)  # -> i, item_1, item_2, item_3, item_4, item_5, G_2, G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
wwr = Panel(cluster.R)
geo = Geometry(cluster.i)
geo_2 = Geometry(cluster.item_1)
geo_3 = Geometry(cluster.item_2)
geo_4 = Geometry(cluster.item_3)
geo_5 = Geometry(cluster.item_4)
geo_6 = Geometry(cluster.item_5)
geo_7 = Geometry(cluster.G_2)
geo_8 = Geometry(cluster.G_4)
geo_9 = Geometry(cluster.G_3)
pt = Point(cluster.pt_5)
pt_2 = Point(cluster.pt_4)
pt_3 = Point(cluster.G)

genes_3 = GenePool(
    Decimals=0,
    Maximum=32,
    Minimum=0,
    Value=[22, 22, 22, 22, 22, 22, 22, 22, 22, 22, 22, 22, 22, 22, 22, 22, 22, 22, 22, 22, 22, 22, 22, 22])

genes_4 = GenePool(
    Decimals=0,
    Maximum=32,
    Minimum=0,
    Value=[22, 22, 22, 22, 22, 22, 24, 24, 25, 25, 25, 25, 25, 25, 25, 25, 25, 25, 25, 24, 24, 22, 22, 22])
genes_5 = GenePool(
    Decimals=0,
    Maximum=32,
    Minimum=0,
    Value=[15, 15, 15, 15, 15, 15, 15, 15, 21, 21, 21, 21, 21, 21, 21, 21, 21, 21, 21, 15, 15, 15, 15, 15])
genes_6 = GenePool(
    Decimals=0,
    Maximum=32,
    Minimum=0,
    Value=[15, 15, 15, 15, 15, 15, 15, 15, 15, 15, 15, 15, 15, 15, 15, 15, 15, 15, 15, 15, 15, 15, 15, 15])
weeklyschedule_2 = HBWeeklySchedule(
    sun=genes_6,
    mon=genes_5,
    tue=genes_5,
    wed=genes_5,
    thu=genes_5,
    fri=genes_5,
    sat=genes_6,
    holiday=genes_6,
    name="Heating Setback",
    type_limit="Temperature")  # -> report, schedule, idf_year, idf_week, idf_days; plug-in component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
weeklyschedule_3 = HBWeeklySchedule(
    sun=genes_3,
    mon=genes_4,
    tue=genes_4,
    wed=genes_4,
    thu=genes_4,
    fri=genes_4,
    sat=genes_3,
    holiday=genes_3,
    name="Cooling Setback",
    type_limit="Temperature")  # -> report, schedule, idf_year, idf_week, idf_days; plug-in component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
setpoint = HBSetpoint(name="Mixed Mode", heating_sch=weeklyschedule_2.schedule, cooling_sch=weeklyschedule_3.schedule)  # -> setpoint; plug-in component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

aperture = HBAperture(geo=geo_7)  # -> report, apertures; plug-in component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
face = HBFace(geo=geo_6)  # -> report, faces; plug-in component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
face_2 = HBFace(geo=geo_5)  # -> report, faces; plug-in component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
face_3 = HBFace(geo=[geo_3, geo, geo_4])  # -> report, faces; plug-in component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
face_4 = HBFace(geo=geo_2)  # -> report, faces; plug-in component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
# M - B  - 02
# 
# Task - Setup of Faces and Apertures
# 
# Description - Using the Base model geometries,
#  all planar geometries are transformed into HB
# objects.
data = Data([face_3.faces, face_2.faces, face.faces])

panel = Panel(weeklyschedule.idf_year)

lighting = HBLighting(name="Watts_room1", watts_per_area=Slider(5, range=0..10), schedule=weeklyschedule.schedule)  # -> lighting; plug-in component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
people = HBPeople(name="People_room1", ppl_per_area=Slider(0.025, range=0..1), occupancy_sch=weeklyschedule.schedule)  # -> people; plug-in component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
equipment = HBEquipment(name="Equipment_room1", watts_per_area=Slider(5, range=0..10), schedule=weeklyschedule.schedule)  # -> equip; plug-in component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

ventilation = HBVentilation(name="Ventilation", ach=Slider(0.063, range=0..1), schedule=weeklyschedule.schedule)  # -> vent; plug-in component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
infiltration = HBInfiltration(name="Infiltration", flow_per_ext_area=Slider(0.0003, range=0..1))  # -> infil; plug-in component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

bldgprograms = HBBuildingPrograms({"LargeOffice", "MediumOffice", "SmallOffice", "MidriseApartment", "HighriseApartment", "Retail", "StripMall", "PrimarySchool", "SecondarySchool", "SmallHotel", "LargeHotel", "Hospital", "Outpatient", "Laboratory", "Warehouse", "SuperMarket", "FullServiceRestaurant", "QuickServiceRestaurant", "Courthouse", "LargeDataCenterHighITE", "LargeDataCenterLowITE", "SmallDataCenterHighITE", "SmallDataCenterLowITE"}, selected="LargeOffice")
searchprog = HBSearchPrograms(bldg_prog=bldgprograms)  # -> room_prog; plug-in component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
item_3 = ListItem(List=searchprog, Index=Slider(17, range=0..23), Wrap=True)
data_2 = Data(item_3)
programtype = HBProgramType(
    name="Office1",
    base_program=data_2,
    people=people,
    lighting=lighting,
    electric_equip=equipment,
    infiltration=infiltration,
    ventilation=ventilation,
    setpoint=setpoint)  # -> program; plug-in component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

Y = UnitY(Factor=1)
ciesky = HBCIEStandardSky(
    north=Y,
    location=importepw.location,
    month=Slider(12, range=0..12),
    day=Slider(31, range=1..31),
    hour=Slider(10, range=0..24),
    type=Slider(0, range=0..5))  # -> sky; plug-in component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

toggle = BooleanToggle(True)
path_6 = FilePath("C:\Users\prana\OneDrive - Delft University of Technology\Thesis\02_Working\Export\20230414_165857\sim_states.xlsx")
xl_in = ReadFromExcel(WorkbookFilepath=path_6, Live=toggle, Stream=toggle)

north_orientation = Slider(7, range=0..7)
shade_type = Slider(11, range=0..11)
shade_type_2 = Panel("0")
colibri_in = ColibriInputsIterator(North_orientation=north_orientation, Shade_type=shade_type, ignoreAllWarningMsg=True)  # -> U, IP, North_orientation, Shade_type, V_N

path_7 = FilePath("C:\Users\prana\OneDrive - Delft University of Technology\Thesis\02_Working\BSDF\01_RB_05_L\RB_3d_5_L.xml")
path_8 = FilePath("C:\Users\prana\OneDrive - Delft University of Technology\Thesis\02_Working\BSDF\02_RB_05_M\RB_3d_5_M.xml")
path_9 = FilePath("C:\Users\prana\OneDrive - Delft University of Technology\Thesis\02_Working\BSDF\03_RB_05_D\RB_3d_5_D.xml")
path_10 = FilePath("C:\Users\prana\OneDrive - Delft University of Technology\Thesis\02_Working\BSDF\04_RB_10_L\RB_3d_10_L.xml")
path_11 = FilePath("C:\Users\prana\OneDrive - Delft University of Technology\Thesis\02_Working\BSDF\05_RB_10_M\RB_3d_10_M.xml")
path_12 = FilePath("C:\Users\prana\OneDrive - Delft University of Technology\Thesis\02_Working\BSDF\06_RB_10_D\RB_3d_10_D.xml")
path_13 = FilePath(["C:\Users\prana\OneDrive - Delft University of Technology\Thesis\02_Working\BSDF\07_VB_25_L\VB_25_0_L.xml", "C:\Users\prana\OneDrive - Delft University of Technology\Thesis\02_Working\BSDF\07_VB_25_L\VB_25_15_L.xml", "C:\Users\prana\OneDrive - Delft University of Technology\Thesis\02_Working\BSDF\07_VB_25_L\VB_25_30_L.xml", "C:\Users\prana\OneDrive - Delft University of Technology\Thesis\02_Working\BSDF\07_VB_25_L\VB_25_45_L.xml", "C:\Users\prana\OneDrive - Delft University of Technology\Thesis\02_Working\BSDF\07_VB_25_L\VB_25_60_L.xml", "C:\Users\prana\OneDrive - Delft University of Technology\Thesis\02_Working\BSDF\07_VB_25_L\VB_25_75_L.xml", "C:\Users\prana\OneDrive - Delft University of Technology\Thesis\02_Working\BSDF\07_VB_25_L\VB_25_90_L.xml"])
path_14 = FilePath(["C:\Users\prana\OneDrive - Delft University of Technology\Thesis\02_Working\BSDF\08_VB_25_M\VB_25_0_M.xml", "C:\Users\prana\OneDrive - Delft University of Technology\Thesis\02_Working\BSDF\08_VB_25_M\VB_25_15_M.xml", "C:\Users\prana\OneDrive - Delft University of Technology\Thesis\02_Working\BSDF\08_VB_25_M\VB_25_30_M.xml", "C:\Users\prana\OneDrive - Delft University of Technology\Thesis\02_Working\BSDF\08_VB_25_M\VB_25_45_M.xml", "C:\Users\prana\OneDrive - Delft University of Technology\Thesis\02_Working\BSDF\08_VB_25_M\VB_25_60_M.xml", "C:\Users\prana\OneDrive - Delft University of Technology\Thesis\02_Working\BSDF\08_VB_25_M\VB_25_75_M.xml", "C:\Users\prana\OneDrive - Delft University of Technology\Thesis\02_Working\BSDF\08_VB_25_M\VB_25_90_M.xml"])
path_15 = FilePath(["C:\Users\prana\OneDrive - Delft University of Technology\Thesis\02_Working\BSDF\09_VB_25_D\VB_25_0_D.xml", "C:\Users\prana\OneDrive - Delft University of Technology\Thesis\02_Working\BSDF\09_VB_25_D\VB_25_15_D.xml", "C:\Users\prana\OneDrive - Delft University of Technology\Thesis\02_Working\BSDF\09_VB_25_D\VB_25_30_D.xml", "C:\Users\prana\OneDrive - Delft University of Technology\Thesis\02_Working\BSDF\09_VB_25_D\VB_25_45_D.xml", "C:\Users\prana\OneDrive - Delft University of Technology\Thesis\02_Working\BSDF\09_VB_25_D\VB_25_60_D.xml", "C:\Users\prana\OneDrive - Delft University of Technology\Thesis\02_Working\BSDF\09_VB_25_D\VB_25_75_D.xml", "C:\Users\prana\OneDrive - Delft University of Technology\Thesis\02_Working\BSDF\09_VB_25_D\VB_25_90_D.xml"])
entwine = Entwine(
    Branch00=path_7,
    Branch01=path_8,
    Branch02=path_9,
    Branch03=path_10,
    Branch04=path_11,
    Branch05=path_12,
    Branch06=path_13,
    Branch07=path_14,
    Branch08=path_15,
    Branch09=path_3,
    Branch010=path_4,
    Branch011=path_5,
    FlattenInputs=True)
simplify = SimplifyTree(Tree=entwine, Front=False)
branch = TreeBranch(Tree=simplify, Path=colibri_in.Shade_type, MaintainPaths=True)
data_3 = Data(branch)
number_slider_4 = Slider(1, range=0..1)
item_4 = ListItem(List=data_3, Index=0, Wrap=True)  # -> Item, Item1, Item2, Item3, Item4, Item5, Item6
bsdfmod = HBBSDFModifier(xml_file=item_4.Item, bsdf_type=number_slider_4)  # -> modifier; plug-in component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
bsdfmod_2 = HBBSDFModifier(xml_file=item_4.Item1, bsdf_type=number_slider_4)  # -> modifier; plug-in component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
bsdfmod_3 = HBBSDFModifier(xml_file=item_4.Item2, bsdf_type=number_slider_4)  # -> modifier; plug-in component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
bsdfmod_4 = HBBSDFModifier(xml_file=item_4.Item3, bsdf_type=number_slider_4)  # -> modifier; plug-in component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
bsdfmod_5 = HBBSDFModifier(xml_file=item_4.Item4, bsdf_type=number_slider_4)  # -> modifier; plug-in component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
bsdfmod_6 = HBBSDFModifier(xml_file=item_4.Item5, bsdf_type=number_slider_4)  # -> modifier; plug-in component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
bsdfmod_7 = HBBSDFModifier(xml_file=item_4.Item6, bsdf_type=number_slider_4)  # -> modifier; plug-in component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

cluster_2 = Cluster_2()  # -> mat, mat_2, mat_3, mat_4, mat_5, mat_6, mat_7, mat_8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
merge = Merge(
    Data1=cluster_2.mat,
    Data2=cluster_2.mat_2,
    Data3=cluster_2.mat_3,
    Data4=cluster_2.mat_4,
    Data5=cluster_2.mat_5,
    Data6=cluster_2.mat_6,
    Data7=cluster_2.mat_7,
    Data8=cluster_2.mat_8,
    Data9=cluster_2.mat_9,
    Data10=cluster_2.mat_10,
    Data11=cluster_2.mat_11,
    Data12=cluster_2.mat_12)
item_5 = ListItem(List=merge, Index=colibri_in.Shade_type, Wrap=True)

searchconstrs = HBSearchConstructions(keywords="window")  # -> opaque_constrs, window_constrs, shade_constrs; plug-in component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
item_6 = ListItem(List=searchconstrs.window_constrs, Index=Slider(37, range=0..100), Wrap=True)
windowconstrshd = HBWindowConstructionShade(win_constr=item_6, shd_material=item_5, shd_location="Exterior", control_type="1", setpoint="150")  # -> constr; plug-in component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

subfacesubset_2 = HBSubfaceSubset(window=item_6)  # -> subface_set; plug-in component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

climatezones = HBClimateZones({"1 - Very Hot": "1", "2 - Hot": "2", "3 - Warm": "3", "4 - Mixed": "4", "5 - Cool": "5", "6 - Cold": "6", "7 - Very Cold": "7", "8 - Subarctic": "8"}, selected="5 - Cool")
bldgvintages = HBBuildingVintages({"ASHRAE 90.1 2019  |  IECC 2021": "2019", "ASHRAE 90.1 2016  |  IECC 2018": "2016", "ASHRAE 90.1 2013  |  IECC 2015": "2013", "ASHRAE 90.1 2010  |  IECC 2012": "2010", "ASHRAE 90.1 2007  |  IECC 2009": "2007", "ASHRAE 90.1 2004  |  IECC 2006": "2004", "1980-2004 (CBECS)": "1980_2004", "Pre-1980 (CBECS)": "pre_1980"}, selected="ASHRAE 90.1 2019  |  IECC 2021")
constructiontypes = HBConstructionTypes({"SteelFramed", "WoodFramed", "Mass", "Metal Building"}, selected="Mass")
constrsetclimate = HBConstructionSetByClimate(climate_zone=climatezones, vintage=bldgvintages, constr_type=constructiontypes)  # -> constr_set; plug-in component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
constructionset = HBConstructionSet(name="Custom Construction", base_constr_set=constrsetclimate, subface_subset=subfacesubset_2)  # -> constr_set; plug-in component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

decnstrconstrset = HBDeconstructConstructionSet(constr_set=constructionset)  # -> exterior_wall, exterior_roof, exposed_floor, ground_wall, ground_roof, ground_floor, window, skylight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; plug-in component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
panel_2 = Panel(decnstrconstrset.ground_floor)
panel_3 = Panel(decnstrconstrset.exterior_wall)
panel_4 = Panel(decnstrconstrset.exterior_roof)
panel_5 = Panel(decnstrconstrset.exposed_floor)
panel_6 = Panel(decnstrconstrset.ground_wall)
panel_7 = Panel(decnstrconstrset.ground_roof)
panel_8 = Panel(decnstrconstrset.window)
panel_9 = Panel(decnstrconstrset.skylight)
panel_10 = Panel(decnstrconstrset.operable)
panel_11 = Panel(decnstrconstrset.exterior_door)
panel_12 = Panel(decnstrconstrset.overhead_door)
panel_13 = Panel(decnstrconstrset.glass_door)

stategeo = HBDynamicStateGeometry(geo=geo_8, name="shade_up", modifier=bsdfmod)  # -> flatten(geo); plug-in component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
stategeo_2 = HBDynamicStateGeometry(geo=geo_9, name="shade_down_0", modifier=bsdfmod)  # -> flatten(geo); plug-in component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
stategeo_3 = HBDynamicStateGeometry(geo=geo_9, name="shade_down_15", modifier=bsdfmod_2)  # -> flatten(geo); plug-in component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
stategeo_4 = HBDynamicStateGeometry(geo=geo_9, name="shade_down_30", modifier=bsdfmod_3)  # -> flatten(geo); plug-in component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
stategeo_5 = HBDynamicStateGeometry(geo=geo_9, name="shade_down_45", modifier=bsdfmod_4)  # -> flatten(geo); plug-in component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
stategeo_6 = HBDynamicStateGeometry(geo=geo_9, name="shade_down_60", modifier=bsdfmod_5)  # -> flatten(geo); plug-in component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
stategeo_7 = HBDynamicStateGeometry(geo=geo_9, name="shade_down_75", modifier=bsdfmod_6)  # -> flatten(geo); plug-in component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
stategeo_8 = HBDynamicStateGeometry(geo=geo_9, name="shade_down_90", modifier=bsdfmod_7)  # -> flatten(geo); plug-in component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
state = HBDynamicState(shades=stategeo)  # -> state; plug-in component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
state_2 = HBDynamicState(shades=stategeo_2)  # -> state; plug-in component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
state_3 = HBDynamicState(shades=stategeo_3)  # -> state; plug-in component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
state_4 = HBDynamicState(shades=stategeo_4)  # -> state; plug-in component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
state_5 = HBDynamicState(shades=stategeo_5)  # -> state; plug-in component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
state_6 = HBDynamicState(shades=stategeo_6)  # -> state; plug-in component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
state_7 = HBDynamicState(shades=stategeo_7)  # -> state; plug-in component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
state_8 = HBDynamicState(shades=stategeo_8)  # -> state; plug-in component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
merge_2 = Merge(Data1=state, Data2=state_2, Data3=state_3, Data4=state_4, Data5=state_5, Data6=state_6, Data7=state_7, Data8=state_8)
aperturegroup = HBDynamicApertureGroup(apertures=aperture.apertures, name="AGB", states=merge_2)  # -> group_aps; plug-in component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

# ---- group: Model with shades for energy
addsubface = HBAddSubface(hb_obj=flatten(face_4.faces), sub_faces=flatten(aperture.apertures))  # -> hb_obj; plug-in component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
bordershades = HBExtrudedBorderShades(hb_objs=flatten(addsubface), depth="0.3")  # -> report, hb_objs; plug-in component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
applywindowconstr = HBApplyWindowConstruction(hb_objs=flatten(bordershades.hb_objs), constr=windowconstrshd)  # -> hb_objs; plug-in component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
room = HBRoom(
    faces=flatten([data, bordershades.hb_objs]),
    mod_set=modifierset,
    constr_set=constructionset,
    program=programtype,
    conditioned=True)  # -> report, room; plug-in component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
model = HBModel(rooms=flatten(room.room))  # -> report, model; plug-in component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

# ----
series = Series(Start=0, Step=Slider(45, range=0..90), Count=Slider(8, range=0..8))
north = Panel(series)
data_4 = Data(north)
item_7 = ListItem(List=data_4, Index=colibri_in.North_orientation, Wrap=True)
compass = LBCompass(north=item_7)  # -> compass; plug-in component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

number_slider_5 = Slider(0, range=0..10)

series_2 = Series(Start="0", Step="500", Count=10)
pt_4 = ConstructPoint(XCoordinate=series_2, YCoordinate="0", ZCoordinate="0")
item_8 = ListItem(List=pt_4, Index=0, Wrap=True)  # -> Item, Item1, Item2, Item3, Item4, Item5, Item6, Item7

path_16 = FilePath("C:\Users\prana\OneDrive - Delft University of Technology\Thesis\02_Working\Export\20230419_113656\00_DGPhours_noshade_transposed.xlsx")
number_slider_6 = Slider(0, range=0..10)
toggle_2 = BooleanToggle(True)
xl_in_2 = ReadFromExcel(WorkbookFilepath=path_16, Live=toggle_2, Stream=toggle_2)
branch_2 = BranchByIndex(Tree=xl_in_2, Branch=Slider(0, range=0..2))  # -> flatten(Results)
item_9 = ListItem(List=branch_2, Index=colibri_in.North_orientation, Wrap=True)

# ---- group: Model including shade for radiance
addsubface_2 = HBAddSubface(hb_obj=flatten(face_4.faces), sub_faces=flatten(aperturegroup))  # -> hb_obj; plug-in component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
bordershades_2 = HBExtrudedBorderShades(hb_objs=flatten(addsubface_2), depth="0.3")  # -> report, hb_objs; plug-in component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
room_2 = HBRoom(
    faces=flatten([data, bordershades_2.hb_objs]),
    mod_set=modifierset,
    constr_set=constructionset,
    program=programtype,
    conditioned=True)  # -> report, room; plug-in component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
model_2 = HBModel(rooms=flatten(room_2.room))  # -> report, model; plug-in component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

# ---- group: Model without shades for radiance
addsubface_3 = HBAddSubface(hb_obj=flatten(face_4.faces), sub_faces=flatten(aperture.apertures))  # -> hb_obj; plug-in component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
bordershades_3 = HBExtrudedBorderShades(hb_objs=flatten(addsubface_3), depth="0.3")  # -> report, hb_objs; plug-in component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
room_3 = HBRoom(
    faces=flatten([data, bordershades_3.hb_objs]),
    mod_set=modifierset,
    constr_set=constructionset,
    program=programtype,
    conditioned=True)  # -> report, room; plug-in component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
model_3 = HBModel(rooms=flatten(room_3.room))  # -> report, model; plug-in component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

# ----
panel_14 = Panel("Surface Shading Device Is On Time Fraction")
python = GhPythonScript(
    v1="Zone Mechanical Ventilation Air Changes per Hour",
    v2="Zone Ventilation Air Change Rate",
    v3=panel_14,
    v4="Transparency SCH")  # -> out, a
# ---------- python: Python ----------
__author__ = "prana"
__version__ = "2023.03.07"

import rhinoscriptsyntax as rs

a = '''\

Output:Variable,
    ,                            !- Key Value
    {v1}, !- Variable Name
    Hourly;                      !- Reporting Frequency


Output:Variable,
    ,                            !- Key Value
    {v2}, !- Variable Name
    Hourly;                      !- Reporting Frequency\


Output:Variable,
    ,                            !- Key Value
    {v3}, !- Variable Name
    Hourly;                      !- Reporting Frequency


Output:Variable,
    ,                            !- Key Value
    {v4}, !- Variable Name
    Hourly;                      !- Reporting Frequency

    '''.format(v1=v1, v2=v2, v3=v3, v4=v4)

print(a)
# ---------- end python ----------
panel_15 = Panel(python.a)

panel_16 = Panel(path_16)

toggle_3 = BooleanToggle(True)
simoutput = HBSimulationOutput(
    zone_energy_use=toggle_3,
    gains_and_losses=toggle_3,
    comfort_metrics=toggle_3,
    surface_temperature=toggle_3,
    surface_energy_flow=toggle_3)  # -> report, sim_output; plug-in component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

python_2 = GhPythonScript(north_orientation=colibri_in.North_orientation, shade_type=colibri_in.Shade_type)  # -> out, state_north_index
# ---------- python_2: Python ----------
__author__ = "prana"
__version__ = "2023.04.17"

import rhinoscriptsyntax as rs

if shade_type <=5:
    state_index = 0
else:
        state_index = 1

north_index = north_orientation

if state_index == 0:
    state_north_index = north_orientation
else:
    state_north_index = 8 + north_orientation
# ---------- end python_2 ----------
branch_3 = BranchByIndex(Tree=xl_in, Branch=python_2.state_north_index)  # -> flatten(Results)
panel_17 = Panel(branch_3)
python_3 = GhPythonScript(light_path="AGB", states=branch_3)  # -> states; inputs states: list
# ---------- python_3: Python ----------
if _light_path and _states:
    states = dict()
    states[_light_path] = _states
    
    states = [states]
# ---------- end python_3 ----------

# ---- group: Model with fixed shade
addsubface_4 = HBAddSubface(hb_obj=flatten(face_4.faces), sub_faces=flatten(aperture.apertures))  # -> hb_obj; plug-in component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
merge_3 = Merge(
    Data1=bsdfmod,
    Data2=bsdfmod,
    Data3=bsdfmod_2,
    Data4=bsdfmod_3,
    Data5=bsdfmod_4,
    Data6=bsdfmod_5,
    Data7=bsdfmod_6,
    Data8=bsdfmod_7)
item_10 = ListItem(List=branch_3, Index=item_9, Wrap=True)
bordershades_4 = HBExtrudedBorderShades(hb_objs=flatten(addsubface_4), depth="0.3")  # -> report, hb_objs; plug-in component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
item_11 = ListItem(List=merge_3, Index=item_10, Wrap=True)
shade = HBShade(geo=geo_9, rad_mod=item_11)  # -> report, shades; plug-in component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
room_4 = HBRoom(
    faces=flatten([data, bordershades_4.hb_objs]),
    mod_set=modifierset,
    constr_set=constructionset,
    program=programtype,
    conditioned=True)  # -> report, room; plug-in component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
model_4 = HBModel(rooms=flatten(room_4.room), shades=flatten(shade.shades))  # -> report, model; plug-in component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

# ----
sensorgrid = HBSensorGrid(positions=pt_3)  # -> grid; plug-in component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
analysisperiod = LBAnalysisPeriod(start_month=1, start_day=1, start_hour=Slider(5, range=0..10), end_hour=Slider(19, range=0..100))  # -> period, hoys, dates; plug-in component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
assigngridsviews = HBAssignGridsAndViews(model=model.model, grids=flatten(sensorgrid))  # -> model; plug-in component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
pmvmap = HBPMVComfortMap(model=assigngridsviews, epw=item, ddy=item_2, north=item_7, run_period=analysisperiod.period, run=Toggle(False))  # -> report, env_conds, temperature, condition, pmv, TCP, HSP, CSP; plug-in component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

simpar = HBSimulationParameter(north=item_7, output=simoutput.sim_output, timestep=6, sizing=sizingpar)  # -> sim_par; plug-in component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
data_5 = Data(item)
toggle_4 = BooleanToggle(False)
modeltoosm = HBModelToOSM(model=model.model, epw_file=data_5, sim_par=simpar, add_str=python.a, write=toggle_4, run=toggle_4)  # -> report, jsons, osw, osm, idf, sql, zsz, rdd, html; plug-in component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

# ---- group: Daylight analysis - Annual
gridrooms = HBSensorGridFromRooms(rooms=room_2.room, grid_size=Slider(1.58, range=0.05..5))  # -> grid, points, mesh; plug-in component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
python_4 = GhPythonScript(grid=gridrooms.grid, light_path="AGB")  # -> grid; inputs light_path: list
# ---------- python_4: Python ----------
grid = _grid.duplicate()
grid.light_path = [[lp for lp in _light_path]]
# ---------- end python_4 ----------
radpar = HBRadianceParameter(recipe_type=Slider(2, range=0..2), additional_par="-ab 2 -aa 0.1 -ar 32 -ad 5120 -as 2560")  # -> rad_par; plug-in component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
assigngridsviews_2 = HBAssignGridsAndViews(model=model_2.model, grids=flatten(python_4))  # -> model; plug-in component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
data_6 = Data(item)
data_7 = Data(weeklyschedule.schedule)
annualdaylight = HBAnnualDaylight(model=assigngridsviews_2, wea=data_6, north=item_7, schedule=data_7, radiance_par=radpar, run=Toggle(False))  # -> report, results, DA, cDA, UDI, UDI_low, UDI_up; plug-in component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

# ---- group: Glare Analysis - No shade - Annual
# This part of the script is used to understand the
#  times in the year with the highest glare
# probibility for all building orientations. This would
# be taken forward to simulate shading systems
# at particular hours in th year.
panel_18 = Panel("-ab 2 -aa 0.1 -ar 32 -ad 5120 -as 2560")
radialgridrooms = HBRadialGridFromRooms(rooms=room_3.room, grid_size=Slider(1.58, range=0.05..5))  # -> grid, points, vecs, mesh; plug-in component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
radpar_2 = HBRadianceParameter(recipe_type=Slider(2, range=0..2), additional_par=panel_18)  # -> rad_par; plug-in component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
assigngridsviews_3 = HBAssignGridsAndViews(model=model_3.model, grids=flatten(radialgridrooms.grid))  # -> model; plug-in component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
data_8 = Data(item)
data_9 = Data(weeklyschedule.schedule)
annualglare = HBImagelessAnnualGlare(model=assigngridsviews_3, wea=data_8, north=item_7, radiance_par=radpar_2, run=Toggle(False))  # -> report, results, GA; plug-in component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

# ----
toggle_5 = BooleanToggle(True)
panel_19 = Panel("3")
thermalmtx = HBReadThermalMatrix(comf_result=pmvmap.temperature, load=toggle_5)  # -> comf_mtx; plug-in component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
thermalmtx_2 = HBReadThermalMatrix(comf_result=pmvmap.pmv, load=toggle_5)  # -> comf_mtx; plug-in component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
envmtx = HBReadEnvironmentMatrix(env_conds=pmvmap.env_conds, metric="0", load=toggle_5)  # -> comf_mtx; plug-in component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
xmatrix = LBDeconstructMatrix(matrix=flatten(thermalmtx))  # -> values; plug-in component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
xmatrix_2 = LBDeconstructMatrix(matrix=flatten(envmtx))  # -> values; plug-in component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
xmatrix_3 = LBDeconstructMatrix(matrix=flatten(thermalmtx_2))  # -> values; plug-in component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
xdata = LBDeconstructData(data=xmatrix)  # -> header, values; plug-in component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
xdata_2 = LBDeconstructData(data=xmatrix_2)  # -> header, values; plug-in component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
xdata_3 = LBDeconstructData(data=xmatrix_3)  # -> header, values; plug-in component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
avr = Average(Input=xdata.values)  # -> flatten(ArithmeticMean)
bang = ExplodeTree(Data=xdata.values)  # -> Branch0, Branch1, Branch2
avr_2 = Average(Input=xdata_2.values)  # -> flatten(ArithmeticMean)
bang_2 = ExplodeTree(Data=xdata_2.values)  # -> Branch0, Branch1, Branch2
avr_3 = Average(Input=xdata_3.values)  # -> flatten(ArithmeticMean)
bang_3 = ExplodeTree(Data=xdata_3.values)  # -> Branch0, Branch1, Branch2
panel_20 = Panel("C:\Users\prana\OneDrive - Delft University of Technology\Thesis\02_Working\Export\trial_14\PMV")
colibri_out = ColibriOutputs(Data=flatten(avr), Data_2=flatten(avr_2), Data_3=flatten(avr_3))
set_img = ColibriImageSetting(
    ImageSaveAsName="defaultName",
    RhinoViewNames="Top+PMV",
    Width=Slider(1600, range=0..10000),
    Height=Slider(900, range=0..1000))
ca = ColibriAggregator(Folder=panel_20, Inputs=colibri_in.IP, Outputs=colibri_out, ImageSetting=set_img, Write=Toggle(False), recordingMode=0)

eui = HBEndUseIntensity(sql=modeltoosm.sql)  # -> eui, eui_end_use, end_uses, gross_floor; plug-in component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
panel_21 = Panel(eui.eui)
panel_22 = Panel(eui.eui_end_use)
panel_23 = Panel(eui.end_uses)
panel_24 = Panel(eui.gross_floor)
simplify_2 = SimplifyTree(Tree=eui.eui_end_use, Front=False)  # -> flatten(Tree)
item_12 = ListItem(List=simplify_2, Index=0, Wrap=True)  # -> Item, Item1
colibri_out_2 = ColibriOutputs(Heating_load=flatten(item_12.Item), Cooling_load=flatten(item_12.Item1))
set_img_2 = ColibriImageSetting(ImageSaveAsName="defaultName", Width="1600", Height="900")
panel_25 = Panel("C:\Users\prana\OneDrive - Delft University of Technology\Thesis\02_Working\Export\trial_14\energy_use")
ca_2 = ColibriAggregator(
    Folder=panel_25,
    Inputs=colibri_in.IP,
    Outputs=colibri_out_2,
    ImageSetting=set_img_2,
    Write=Toggle(False),
    recordingMode=0)
panel_26 = Panel(ca_2)

merge_4 = Merge(Data1="6", Data2="6", Data3="6")
set_img_3 = ColibriImageSetting(ImageSaveAsName="defaultName", Width=Slider(1600, range=0..10000), Height=Slider(900, range=0..1000))

panel_27 = Panel("""500
3000""")
daylightmetrics = HBAnnualDaylightMetrics(results=annualdaylight.results, states=python_3, occ_sch=weeklyschedule.schedule, min_max=panel_27)  # -> report, DA, cDA, UDI, UDI_low, UDI_up; plug-in component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
col = Colour(ColourSwatch(SwatchColor=RGB(142, 98, 96)))
col_2 = Colour(ColourSwatch(SwatchColor=RGB(74, 127, 113)))
merge_5 = Merge(Data1=col_2, Data2=col)
panel_28 = Panel(annualdaylight.UDI)
legendpar = LBLegendParameters()  # -> leg_par; plug-in component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
panel_29 = Panel(daylightmetrics.UDI)
colibri_out_3 = ColibriOutputs(
    UDI_shades=flatten(daylightmetrics.UDI),
    UDI_noshades=flatten(annualdaylight.UDI),
    UDI_low=flatten(daylightmetrics.UDI_low))
panel_30 = Panel("C:\Users\prana\OneDrive - Delft University of Technology\Thesis\02_Working\Export\trial_17\UDI")
ca_3 = ColibriAggregator(
    Folder=panel_30,
    Inputs=colibri_in.IP,
    Outputs=colibri_out_3,
    ImageSetting=set_img_3,
    Write=Toggle(False),
    recordingMode=0)

heatmap = LBSpatialHeatmap(values=daylightmetrics.UDI, mesh=gridrooms.mesh, legend_par=legendpar)  # -> mesh, legend, title, colors, legend_par, vis_set; plug-in component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

# ---- group: DGP_someshade_annual
item_13 = ListItem(List=pt_2, Index=0, Wrap=True)  # -> Item, Item1, Item2
radialgridrooms_2 = HBRadialGridFromRooms(rooms=room_4.room, grid_size=Slider(1.58, range=0.05..5))  # -> grid, points, vecs, mesh; plug-in component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
radpar_3 = HBRadianceParameter(recipe_type=Slider(2, range=0..2), additional_par="-ab 2 -aa 0.1 -ar 32 -ad 5120 -as 2560")  # -> rad_par; plug-in component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
assigngridsviews_4 = HBAssignGridsAndViews(model=model_4.model, grids=flatten(radialgridrooms_2.grid))  # -> model; plug-in component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
data_10 = Data(item)
data_11 = Data(weeklyschedule.schedule)
annualglare_2 = HBImagelessAnnualGlare(model=assigngridsviews_4, wea=data_10, north=item_7, radiance_par=radpar_3, run=Toggle(True))  # -> report, results, GA; plug-in component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

# ----
colrange = LBColorRange(index="6")  # -> colors; plug-in component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
colrange_2 = LBColorRange(index="6")  # -> colors; plug-in component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
colrange_3 = LBColorRange(index="6")  # -> colors; plug-in component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
merge_6 = Merge(Data1="32")
merge_7 = Merge(Data1="24")
merge_8 = Merge(Data1="6")
merge_9 = Merge(Data1="6")
merge_10 = Merge(Data1="40")
rev = ReverseList(List=colrange)
rev_2 = ReverseList(List=colrange_2)
merge_11 = Merge(Data1="6")
rev_3 = ReverseList(List=colrange_3)
pt_5 = Point(radialgridrooms_2.points)
vec = Vector(radialgridrooms_2.vecs)
pt_6 = Point(radialgridrooms_2.points)
vec_2 = Vector(radialgridrooms_2.vecs)
data_12 = Data(annualglare_2.results)
data_13 = Data(annualglare_2.results)
pt_7 = Point(radialgridrooms_2.points)
vec_3 = Vector(radialgridrooms_2.vecs)
data_14 = Data(annualglare_2.results)
legendpar_2 = LBLegendParameters(min="50", max="100", colors=rev, num_decimals="0")  # -> leg_par; plug-in component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
legendpar_3 = LBLegendParameters(min="50", max="100", colors=rev_2, num_decimals="0")  # -> leg_par; plug-in component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
legendpar_4 = LBLegendParameters(min="50", max="100", colors=rev_3, num_decimals="0")  # -> leg_par; plug-in component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
bang_4 = ExplodeTree(Data=pt_6)  # -> Branch0, Branch1
bang_5 = ExplodeTree(Data=vec_2)  # -> Branch0, Branch1
bang_6 = ExplodeTree(Data=pt_5)  # -> Branch0, Branch1
bang_7 = ExplodeTree(Data=vec)  # -> Branch0, Branch1
bang_8 = ExplodeTree(Data=pt_7)  # -> Branch0, Branch1
bang_9 = ExplodeTree(Data=vec_3)  # -> Branch0, Branch1
item_14 = ListItem(List=bang_4.Branch0, Index=merge_6, Wrap=True)
item_15 = ListItem(List=bang_5.Branch0, Index=merge_8, Wrap=True)
item_16 = ListItem(List=bang_6.Branch0, Index=merge_7, Wrap=True)
item_17 = ListItem(List=bang_7.Branch0, Index=merge_9, Wrap=True)
item_18 = ListItem(List=bang_8.Branch0, Index=merge_10, Wrap=True)
item_19 = ListItem(List=bang_9.Branch0, Index=merge_11, Wrap=True)
vdis = VectorDisplay(Anchor=item_14, Vector=item_15)
vdis_2 = VectorDisplay(Anchor=item_16, Vector=item_17)
vdis_3 = VectorDisplay(Anchor=item_18, Vector=item_19)
heatmap_2 = LBSpatialHeatmap(
    values=annualglare_2.GA,
    mesh=radialgridrooms_2.mesh,
    legend_par=legendpar_2,
    legend_title="%",
    global_title="Glare Autonomy")  # -> mesh, legend, title, colors, legend_par, vis_set; plug-in component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
heatmap_3 = LBSpatialHeatmap(
    values=annualglare_2.GA,
    mesh=radialgridrooms_2.mesh,
    legend_par=legendpar_3,
    legend_title="%",
    global_title="Glare Autonomy")  # -> mesh, legend, title, colors, legend_par, vis_set; plug-in component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
heatmap_4 = LBSpatialHeatmap(
    values=annualglare_2.GA,
    mesh=radialgridrooms_2.mesh,
    legend_par=legendpar_4,
    legend_title="%",
    global_title="Glare Autonomy")  # -> mesh, legend, title, colors, legend_par, vis_set; plug-in component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
annualtodata = HBAnnualResultsToData(results=data_13, sel_pts=flatten(item_14), all_pts=pt_6, sel_vecs=flatten(item_15), all_vecs=vec_2)  # -> report, data; plug-in component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
annualtodata_2 = HBAnnualResultsToData(results=data_12, sel_pts=flatten(item_16), all_pts=pt_5, sel_vecs=flatten(item_17), all_vecs=vec)  # -> report, data; plug-in component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
annualtodata_3 = HBAnnualResultsToData(results=data_14, sel_pts=flatten(item_18), all_pts=pt_7, sel_vecs=flatten(item_19), all_vecs=vec_3)  # -> report, data; plug-in component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
hourlyplot = LBHourlyPlot(data=annualtodata.data, base_pt=item_8.Item3)  # -> report, mesh, legend, borders, labels, title, vis_set; plug-in component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
hourlyplot_2 = LBHourlyPlot(data=annualtodata_2.data, base_pt=item_8.Item3)  # -> report, mesh, legend, borders, labels, title, vis_set; plug-in component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
hourlyplot_3 = LBHourlyPlot(data=annualtodata_3.data, base_pt=item_8.Item3)  # -> report, mesh, legend, borders, labels, title, vis_set; plug-in component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
xdata_4 = LBDeconstructData(data=annualtodata.data)  # -> header, values; plug-in component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
xdata_5 = LBDeconstructData(data=annualtodata_2.data)  # -> header, values; plug-in component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
xdata_6 = LBDeconstructData(data=annualtodata_3.data)  # -> header, values; plug-in component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
item_20 = ListItem(List=xdata_4.values, Index=item_9, Wrap=True)
item_21 = ListItem(List=xdata_5.values, Index=item_9, Wrap=True)
item_22 = ListItem(List=xdata_6.values, Index=item_9, Wrap=True)
panel_31 = Panel("C:\Users\prana\OneDrive - Delft University of Technology\Thesis\02_Working\Export\trial_16\Visual_DGP_Someshade_5m")
panel_32 = Panel("C:\Users\prana\OneDrive - Delft University of Technology\Thesis\02_Working\Export\trial_16\Visual_DGP_Someshade_3m")
panel_33 = Panel("C:\Users\prana\OneDrive - Delft University of Technology\Thesis\02_Working\Export\trial_16\Visual_DGP_Someshade_1m")
colibri_out_4 = ColibriOutputs(i=flatten(item_20))
colibri_out_5 = ColibriOutputs(i=flatten(item_22))
colibri_out_6 = ColibriOutputs(Data=flatten(item_21))
set_img_4 = ColibriImageSetting(ImageSaveAsName="defaultName", Width=Slider(1600, range=0..10000), Height=Slider(900, range=0..10000))
set_img_5 = ColibriImageSetting(ImageSaveAsName="defaultName", Width=Slider(1600, range=0..10000), Height=Slider(900, range=0..10000))
set_img_6 = ColibriImageSetting(ImageSaveAsName="defaultName", Width=Slider(1600, range=0..10000), Height=Slider(900, range=0..10000))
ca_4 = ColibriAggregator(
    Folder=panel_32,
    Inputs=colibri_in.IP,
    Outputs=colibri_out_4,
    ImageSetting=set_img_4,
    Write=Toggle(False),
    recordingMode=0)
ca_5 = ColibriAggregator(
    Folder=panel_31,
    Inputs=colibri_in.IP,
    Outputs=colibri_out_6,
    ImageSetting=set_img_5,
    Write=Toggle(False),
    recordingMode=0)
ca_6 = ColibriAggregator(
    Folder=panel_33,
    Inputs=colibri_in.IP,
    Outputs=colibri_out_5,
    ImageSetting=set_img_6,
    Write=Toggle(False),
    recordingMode=0)

customresult = HBReadCustomResult(sql=modeltoosm.sql, output_names=panel_14)  # -> results; plug-in component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
xdata_7 = LBDeconstructData(data=customresult)  # -> header, values; plug-in component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
bang_10 = ExplodeTree(Data=xdata_7.values)  # -> Branch0, Branch1, Branch2, Branch3, Branch4
simplify_3 = SimplifyTree(Tree=bang_10.Branch0, Front=False)  # -> flatten(Tree)

item_23 = ListItem(List=customresult, Index=0, Wrap=True)

hourlyplot_4 = LBHourlyPlot(data=item_23, base_pt=item_8.Item1)  # -> report, mesh, legend, borders, labels, title, vis_set; plug-in component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

pt_8 = Point(radialgridrooms.points)
vec_4 = Vector(radialgridrooms.vecs)
data_15 = Data(annualglare.results)
colrange_4 = LBColorRange(index="6")  # -> colors; plug-in component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
merge_12 = Merge(Data1="24", Data2="32", Data3="40")
rev_4 = ReverseList(List=colrange_4)
bang_11 = ExplodeTree(Data=pt_8)  # -> Branch0, Branch1
bang_12 = ExplodeTree(Data=vec_4)  # -> Branch0, Branch1
legendpar_5 = LBLegendParameters(min="50", max="100", colors=rev_4, num_decimals="0")  # -> leg_par; plug-in component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
item_24 = ListItem(List=bang_11.Branch0, Index=merge_12, Wrap=True)
item_25 = ListItem(List=bang_12.Branch0, Index=merge_4, Wrap=True)
vdis_4 = VectorDisplay(Anchor=item_24, Vector=item_25)
annualtodata_4 = HBAnnualResultsToData(results=data_15, sel_pts=flatten(item_24), all_pts=pt_8, sel_vecs=flatten(item_25), all_vecs=vec_4)  # -> report, data; plug-in component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
heatmap_5 = LBSpatialHeatmap(
    values=annualglare.GA,
    mesh=radialgridrooms.mesh,
    legend_par=legendpar_5,
    legend_title="%",
    global_title="Glare Autonomy")  # -> mesh, legend, title, colors, legend_par, vis_set; plug-in component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
xdata_8 = LBDeconstructData(data=annualtodata_4.data)  # -> header, values; plug-in component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
sort = SortList(Keys=xdata_8.values)  # -> Keys, ValuesA
hourlyplot_5 = LBHourlyPlot(data=annualtodata_4.data, base_pt=item_8.Item2)  # -> report, mesh, legend, borders, labels, title, vis_set; plug-in component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
rev_5 = ReverseList(List=sort.Keys)
item_26 = ListItem(List=rev_5, Index=0, Wrap=True)
mindex = MemberIndex(Set=xdata_8.values, Member=item_26)  # -> Index, Count
panel_34 = Panel("C:\Users\prana\OneDrive - Delft University of Technology\Thesis\02_Working\Export\trial_16\Visual_DGP_noshade_Hourly")
set_img_7 = ColibriImageSetting(ImageSaveAsName="defaultName", Width=Slider(1600, range=0..10000), Height=Slider(900, range=0..10000))

# ---- group: DGP_someshade_annual (continued)
item_27 = ListItem(List=item_25, Index=0, Wrap=True)
view = HBView(name="View1", position=item_13.Item, direction=item_27)  # -> view; plug-in component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
view_2 = HBView(name="View2", position=item_13.Item1, direction=item_27)  # -> view; plug-in component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
view_3 = HBView(name="View3", position=item_13.Item2, direction=item_27)  # -> view; plug-in component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
merge_13 = Merge(Data1=view, Data2=view_2, Data3=view_3)
assigngridsviews_5 = HBAssignGridsAndViews(model=model_4.model, grids=flatten(radialgridrooms_2.grid), views=flatten(merge_13))  # -> model; plug-in component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
pitview = HBPointInTimeViewBased(model=assigngridsviews_5, sky=ciesky, run=Toggle(False))  # -> report, results; plug-in component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

# ----
bang_13 = ExplodeTree(Data=item_26)  # -> Branch0, Branch1, Branch2
bang_14 = ExplodeTree(Data=mindex.Index)  # -> Branch0, Branch1, Branch2
item_28 = ListItem(List=flatten(bang_14.Branch0), Index=0, Wrap=True)
item_29 = ListItem(List=flatten(bang_14.Branch2), Index=0, Wrap=True)

item_30 = ListItem(List=flatten(bang_14.Branch1), Index=0, Wrap=True)
colibri_out_7 = ColibriOutputs(
    index_at_5m=flatten(item_28),
    index_at_3m=flatten(item_30),
    index_at_1m=flatten(item_29),
    value_at_5m=flatten(bang_13.Branch0),
    value_at_3m=flatten(bang_13.Branch1),
    value_at_1m=flatten(bang_13.Branch2))
ca_7 = ColibriAggregator(
    Folder=panel_34,
    Inputs=colibri_in.IP,
    Outputs=colibri_out_7,
    ImageSetting=set_img_7,
    Write=Toggle(False),
    recordingMode=0)

# ==== cluster Cluster
pt = ConstructPoint(XCoordinate="0", YCoordinate="0", ZCoordinate="0")
X = ClusterInput()
Y = ClusterInput()
F = ClusterInput()
A = ClusterInput()
rectangle = Rectangle(Plane=pt, XSize=X, YSize=Y, Radius=0)  # -> Rectangle, Length
Z = UnitZ(Factor=F)
division = Division(A=A, B="2")
extr = Extrude(Base=rectangle.Rectangle, Direction=Z)
cap = CapHoles(Brep=extr)
debrep = DeconstructBrep(Brep=cap)  # -> Faces, Edges, Vertices
item = ListItem(List=debrep.Faces, Index=0, Wrap=True)  # -> Item, Item1, Item2, Item3, Item4, Item5
i = ClusterOutput(item.Item)
item_1 = ClusterOutput(item.Item1)
item_2 = ClusterOutput(item.Item2)
item_3 = ClusterOutput(item.Item3)
item_4 = ClusterOutput(item.Item4)
item_5 = ClusterOutput(item.Item5)
debrep_2 = DeconstructBrep(Brep=item.Item1)  # -> Faces, Edges, Vertices
item_6 = ListItem(List=debrep_2.Edges, Index=expr("2", 0), Wrap=True)
explode = Explode(Curve=debrep_2.Edges, Recursive=True)  # -> flatten(Segments), Vertices
panel = Panel("""1
3
5""")
item_7 = ListItem(List=explode.Segments, Index=expr("2", 0), Wrap=True)
midpt = CurveMiddle(Curve=item_6)
N = ClusterInput()
Y_2 = UnitY(Factor=panel)
divide = DivideCurve(Curve=item_7, Count=N, Kinks=False)  # -> Points, Tangents, Parameters
move = Move(Geometry=midpt, Motion=Y_2)  # -> Geometry, Transform
Z_2 = UnitZ(Factor=Slider(0.75, range=0..1))
Z_3 = UnitZ(Factor=Slider(1.35, range=0..2))
shatter = Shatter(Curve=item_7, Parameters=divide.Parameters)
move_2 = Move(Geometry=move.Geometry, Motion=Z_2)  # -> Geometry, Transform
move_3 = Move(Geometry=move.Geometry, Motion=Z_3)  # -> Geometry, Transform
X_2 = UnitX(Factor=expr("-x", division))
crvmidpt = CurveMiddlePoint(Curve=shatter, EvaluationType=False)  # -> Middle, Tangent, Parameter, Length
len = Length(Curve=shatter)
X_3 = UnitX(Factor=division)
pt_2 = Point(move_2.Geometry)
G = ClusterOutput(move_2.Geometry)
pt_3 = Point(move_3.Geometry)
move_4 = Move(Geometry=crvmidpt.Middle, Motion=X_3)  # -> Geometry, Transform
move_5 = Move(Geometry=crvmidpt.Middle, Motion=X_2)  # -> Geometry, Transform
F_2 = ClusterInput()
pt_4 = ClusterOutput(pt_3)
F_3 = ClusterInput()
pt_5 = ClusterOutput(pt_2)
A_2 = ClusterInput()
B = ClusterInput()
Z_4 = UnitZ(Factor=F_2)
Z_5 = UnitZ(Factor=F_3)
ln = Line(StartPoint=move_4.Geometry, EndPoint=move_5.Geometry)
addition = Addition(A=A_2, B=B)
extr_2 = Extrude(Base=ln, Direction=Z_4)
F_4 = ClusterInput()
F_5 = ClusterInput()
Y_3 = UnitY(Factor=expr("-x", Slider(0.1, range=0..0.3)))
Z_6 = UnitZ(Factor=addition)
move_6 = Move(Geometry=extr_2, Motion=Z_5)  # -> Geometry, Transform
Z_7 = UnitZ(Factor=F_4)
Z_8 = UnitZ(Factor=F_5)
G_2 = ClusterOutput(move_6.Geometry)
area = Area(Geometry=item.Item1)  # -> Area, Centroid
area_2 = Area(Geometry=move_6.Geometry)  # -> Area, Centroid
move_7 = Move(Geometry=ln, Motion=Z_6)  # -> Geometry, Transform
extr_3 = Extrude(Base=move_7.Geometry, Direction=expr("-x", Z_7))
extr_4 = Extrude(Base=move_7.Geometry, Direction=expr("-x", Z_8))
ma = MassAddition(Input=area_2.Area)  # -> Result, PartialResults
division_2 = Division(A=ma.Result, B=area.Area)
move_8 = Move(Geometry=extr_4, Motion=Y_3)  # -> Geometry, Transform
move_9 = Move(Geometry=extr_3, Motion=Y_3)  # -> Geometry, Transform
R = ClusterOutput(division_2)
G_3 = ClusterOutput(move_8.Geometry)
G_4 = ClusterOutput(move_9.Geometry)

# ==== cluster Cluster_2
blindmat = HBBlindMaterial(
    name="VB_25_L",
    slat_width="0.025",
    slat_separation="0.025",
    slat_thickness="0.001",
    slat_angle="45",
    transmittance="0",
    reflectance="0.75",
    dist_to_glass="0.05")  # -> mat; plug-in component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
blindmat_2 = HBBlindMaterial(
    name="VB_25_M",
    slat_width="0.025",
    slat_separation="0.025",
    slat_thickness="0.001",
    slat_angle="45",
    transmittance="0",
    reflectance="0.37",
    dist_to_glass="0.05")  # -> mat; plug-in component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
blindmat_3 = HBBlindMaterial(
    name="VB_25_D",
    slat_width="0.025",
    slat_separation="0.025",
    slat_thickness="0.001",
    slat_angle="45",
    transmittance="0",
    reflectance="0.04",
    dist_to_glass="0.05")  # -> mat; plug-in component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
blindmat_4 = HBBlindMaterial(
    name="VB_50_L",
    slat_width="0.05",
    slat_separation="0.05",
    slat_thickness="0.001",
    slat_angle="45",
    transmittance="0",
    reflectance="0.75",
    dist_to_glass="0.05")  # -> mat; plug-in component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
blindmat_5 = HBBlindMaterial(
    name="VB_50_M",
    slat_width="0.05",
    slat_separation="0.05",
    slat_thickness="0.001",
    slat_angle="45",
    transmittance="0",
    reflectance="0.37",
    dist_to_glass="0.05")  # -> mat; plug-in component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
blindmat_6 = HBBlindMaterial(
    name="VB_50_M",
    slat_width="0.05",
    slat_separation="0.05",
    slat_thickness="0.001",
    slat_angle="45",
    transmittance="0",
    reflectance="0.04",
    dist_to_glass="0.05")  # -> mat; plug-in component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
shademat = HBShadeMaterial(name="RB_5_L", thickness="2.5", transmittance="0.25", reflectance="0.55", dist_to_glass="0.05", permeability="0.05")  # -> mat; plug-in component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
shademat_2 = HBShadeMaterial(name="RB_5_M", thickness="2.5", transmittance="0.11", reflectance="0.28", dist_to_glass="0.05", permeability="0.05")  # -> mat; plug-in component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
shademat_3 = HBShadeMaterial(name="RB_5_D", thickness="2.5", transmittance="0.05", reflectance="0.06", dist_to_glass="0.05", permeability="0.05")  # -> mat; plug-in component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
shademat_4 = HBShadeMaterial(name="RB_10_L", thickness="2.5", transmittance="0.25", reflectance="0.55", dist_to_glass="0.05", permeability="0.1")  # -> mat; plug-in component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
shademat_5 = HBShadeMaterial(name="RB_10_M", thickness="2.5", transmittance="0.11", reflectance="0.28", dist_to_glass="0.05", permeability="0.1")  # -> mat; plug-in component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
shademat_6 = HBShadeMaterial(name="RB_10_D", thickness="2.5", transmittance="0.05", reflectance="0.06", dist_to_glass="0.05", permeability="0.1")  # -> mat; plug-in component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
mat = ClusterOutput(shademat)
mat_2 = ClusterOutput(shademat_2)
mat_3 = ClusterOutput(shademat_3)
mat_4 = ClusterOutput(shademat_4)
mat_5 = ClusterOutput(shademat_5)
mat_6 = ClusterOutput(shademat_6)
mat_7 = ClusterOutput(blindmat)
mat_8 = ClusterOutput(blindmat_2)
mat_9 = ClusterOutput(blindmat_3)
mat_10 = ClusterOutput(blindmat_4)
mat_11 = ClusterOutput(blindmat_5)
mat_12 = ClusterOutput(blindmat_6)
